# Grasshopper definition _aggregator.gh (Grasshopper 1.0.7)

crv_a = Curve(<curve referenced from the Rhino model>)
crv_b = Curve(<curve referenced from the Rhino model>)

# ---- group: piecewise operations
# split only: [{"fname":"hex_split_a.ply","type":"bool","btype":"intersection"}]
# [{"fname":"hex_split_b.ply","type":"bool","btype":"intersection"}]
# [{"fname":"hex_split_c.ply","type":"bool","btype":"intersection"}]
# split exp and thicken for 3d prints: [{"fname":"hex_split_exp_a.ply","type":"bool","btype":"intersection"},{"fname":"hex_diff_a.ply","type":"thicken_and_cut","ofst":-0.045}]
# [{"fname":"hex_split_exp_b.ply","type":"bool","btype":"intersection"},{"fname":"hex_diff_b.ply","type":"thicken_and_cut","ofst":-0.045}]
# [{"fname":"hex_split_exp_c.ply","type":"bool","btype":"intersection"},{"fname":"hex_diff_c.ply","type":"thicken_and_cut","ofst":-0.045}]
split_and_thicken_for_3d_prints = Panel("""[{"fname":"hex_split_a.ply","type":"bool","btype":"intersection"},{"fname":"hex_diff_a.ply","type":"thicken_and_cut","ofst":-0.045}]
[{"fname":"hex_split_b.ply","type":"bool","btype":"intersection"},{"fname":"hex_diff_b.ply","type":"thicken_and_cut","ofst":-0.045}]
[{"fname":"hex_split_c.ply","type":"bool","btype":"intersection"},{"fname":"hex_diff_c.ply","type":"thicken_and_cut","ofst":-0.045}]""")

# ---- group: translation vec for split pieces
line = Line(Line((-1.166571872, -5.009253898, 0), (-1.637256679, -4.737503898, 0)))
line_2 = Line(Line((-1.166571872, -5.009253898, 0), (-0.6958870655, -4.737503898, 0)))
line_3 = Line(Line((-1.166571872, -5.009253898, 0), (-1.166571872, -5.552753898, 0)))
vec = Vector(line_3)
vec_2 = Vector(line)
vec_3 = Vector(line_2)
unit = UnitVector(Vector=vec_2)
unit_2 = UnitVector(Vector=vec_3)
unit_3 = UnitVector(Vector=vec)
merge = Merge(Data1=unit_3, Data2=unit, Data3=unit_2)

# ---- group: operations to take on the whole solid
panel = Panel("{\"fname\":\"hex_pegs.ply\",\"type\":\"bool\",\"btype\":\"union\"},{\"fname\":\"hex_mount.ply\",\"type\":\"bool\",\"btype\":\"difference\"}")
panel_2 = Panel("")

# ----
# Import into Blender with Y Up
# and
# -Z Forward.
number_slider = Slider(0.03, range=0..0.2)
pt = Point([Point(0, -0.25, 0), Point(-0.2165063509, 0.125, 0), Point(0.2165063509, 0.125, 0)])
panel_3 = Panel(pt)
magic_number = Number("0.866")
spacing = Number(number_slider)
magic_number_2 = Number(magic_number)
spacing_2 = Number(spacing)
python = GhPythonScript(
    magic_num=magic_number_2,
    spacing=spacing_2,
    operations=split_and_thicken_for_3d_prints,
    vecs_spacing=merge,
    pts_center=panel_3)  # -> out, a, b; inputs operations: list, vecs_spacing: list, pts_center: list of Point3d
# ---------- python: Python ----------
__author__ = "ksteinfe"
__version__ = "2021.09.21"

import rhinoscriptsyntax as rs
import json

chars = 'abcdefghijkl'
chars = chars[:len(operations)]

ops = []
for o in operations:
    ops.append(json.loads(o))

lst = []

vecs_spacing = [ v * ( spacing / magic_num * 0.25 ) for v in vecs_spacing] # no idea

for n,b,v,p in zip(chars,ops,vecs_spacing,pts_center):
    lst.append({'name':n, 'ops':b, 'vec_spacing':[v.X,v.Y], 'ctr':[p.X,p.Y]})
    
    
a = json.dumps(lst)
b = vecs_spacing
# ---------- end python ----------
magic_number_3 = Number(magic_number)

crv = Curve([<curve referenced from the Rhino model> x3])
pt_2 = Point(Point(-1.166571872, -5.009253898, 0))

crv_a_2 = Curve(crv_a)
crv_b_2 = Curve(crv_b)
spacing_3 = Number(spacing)
move = Move(Geometry=crv, Motion=python.b)  # -> Geometry, Transform
python_2 = GhPythonScript(
    engrave_dir="engrave_id_longside",
    magic_num=magic_number_3,
    crv_a=crv_a_2,
    crv_b=crv_b_2,
    spacing=spacing_3,
    operations=panel_2,
    piecewise=python.a)  # -> out, a, b, c, d; inputs crv_a: Polyline, crv_b: Polyline
# ---------- python_2: Python ----------
__author__ = "ksteinfe"
__version__ = "2021.09.20"

import Rhino.Geometry.Point3d as Point3d
import Rhino.Geometry.Line as Line
import Rhino.Geometry.Vector3d as Vector3d
import rhinoscriptsyntax as rs
import json, math

scl = (magic_num + spacing) / magic_num

ctr = (crv_a.CenterPoint() + crv_b.CenterPoint() )/2
a = ctr

str_jsn = """
{
    "engrave_dir":{{e}},
    "piecewise":{{f}},
    "ops":[{{b}}],
    "samples":{{s}}
}
"""
if engrave_dir: str_jsn = str_jsn.replace("{{e}}",'"{}"'.format(engrave_dir))
else: str_jsn = str_jsn.replace("{{e}}",'false')
str_jsn = str_jsn.replace("{{f}}",piecewise)
str_jsn = str_jsn.replace("{{b}}",operations)

lst = []
pts = []
lbls = []
for n,(pa,pb) in enumerate(zip(crv_a, crv_b)):
    ang = int( math.degrees(Vector3d.VectorAngle( Line(pa,pb).Direction, Vector3d(-1,0,0))) ) 
    def f(p,s,do_mirror):
        pt = (p-ctr)*scl
        pts.append(pt)
        lbls.append(s.format(n))
        lst.append({
            'name': s.format(n),
            'vec': (pt.X,pt.Y),
            'do_mirror': do_mirror,
            'mirror_rot': ang
        })
    
    f(pa, "0{:02d}",False)
    f(pb, "1{:02d}",True)
    
b = str_jsn.replace("{{s}}",json.dumps(lst))
c = pts
d = lbls
# ---------- end python_2 ----------
vec2pt = Vector2Pt(PointA=pt_2, PointB=python_2.c, Unitize=False)  # -> Vector, Length
move_2 = Move(Geometry=graft(move.Geometry), Motion=vec2pt.Vector)  # -> Geometry, Transform
X = UnitX(Factor=1)
xy = XYPlane(Origin=python_2.c)
rotate = Rotate(Geometry=X, Angle=1.570796327, Plane=PlaneXY(0, 0, 0))  # -> Geometry, Transform
align = AlignPlane(Plane=xy, Direction=rotate.Geometry)  # -> Plane, Angle
tag = TextTag3D(Location=xy, Text=python_2.d, Size="0.1", Justification=5)
polygon = Polygon(Plane=align.Plane, Radius=0.5, Segments=6, FilletRadius=0)  # -> Polygon, Length
panel_4 = Panel(python_2.b)
