# Grasshopper definition _engraver.gh (Grasshopper 1.0.7)
# plug-ins: Bowerbird2

toggle = BooleanToggle(True)
python = GhPythonScript(x=Slider(1, range=0..1), y=Slider(50, range=0..50))  # -> out, a, b, c; inputs x: Int32, y: Int32
# ---------- python: Python ----------
__author__ = "ksteinfe"
__version__ = "2021.09.20"

import rhinoscriptsyntax as rs

y = "{:02d}".format(y)
a = str(x)
b = y[0]
c = y[1]
# ---------- end python ----------
format = Format(Format="_engrave_{0}{1}{2}", Culture=127, Data0=python.a, Data1=python.b, Data2=python.c)
format_2 = Format(Format="{0} {1} {2}", Culture=127, Data0=python.a, Data1=python.b, Data2=python.c)
fname = Text(format)
fname_2 = Text(fname)
panel = Panel("0 0 0")
panel_2 = Panel("""A
B
C""")
panel_3 = Panel("""{0}











{1}""")
format_3 = Format(Format=panel_3, Culture=127, Data0=format_2, Data1=panel_2)
pln = Plane([Plane(origin=(0.4999999971, 0.2550000002, 0), x=(-5.552611093e-08, 1, 0), y=(-1, -5.552611093e-08, 0)), Plane(origin=(0.2878237776, 0.6225000024, 0), x=(0.8660254315, -0.4999999519, 0), y=(0.4999999519, 0.8660254315, 0)), Plane(origin=(0.7121762252, 0.6224999974, 0), x=(-0.866025376, -0.5000000481, 0), y=(0.5000000481, -0.866025376, 0))])
Z = UnitZ(Factor="-0.03")
move = Move(Geometry=pln, Motion=Z)  # -> Geometry, Transform
pflip = FlipPlane(Plane=move.Geometry, ReverseX=True, ReverseY=False, SwapAxes=False)
bbtext = BBText(Location=pflip, Text=format_3, Size="0.035", Bold=False, HorizontalAlignment=0, VerticalAlignment=0)
Z_2 = UnitZ(Factor=-0.5)
divlength = DivideLength(Curve=bbtext, Length="0.004")  # -> Points, Tangents, Parameters
pline = PolyLine(Vertices=divlength.Points, Closed=False)
bboffset = BBOffset(Curves=pline, Distance="0.004", EndType=0, JoinType=0, MiterLimit=10, ArcTolerance=0.01)  # -> flatten(Curve)
boundary = BoundarySurfaces(Edges=bboffset)
Z_3 = UnitZ(Factor="-0.2")
extr = Extrude(Base=boundary, Direction=Z_3)
sunion = SolidUnion(Breps=extr)
mesh = MeshBrep(
    Brep=sunion,
    Settings={GridMaxCount=0, GridMinCount=16, JaggedSeams=False, MaxEdgeLength=0, MinEdgeLength=0.0001, MinTolerance=0, Refine=True, RefineAngle=0, RelativeTolerance=0.65, SimplePlanes=True, Tolerance=0})
msh_out = Mesh(mesh)
msh_out_2 = Mesh(msh_out)

# ---- group: save OBJ
c_script = CSharpScript(in_run=Button(), in_mesh=msh_out_2, in_name=fname_2, in_path="C:\tmp\")  # -> out, A; inputs in_run: Boolean, in_mesh: list of Mesh, in_name: String, in_path: String
# ---------- c_script: C# usings ----------
using System.IO;
using System.Linq;
using System.Data;
using System.Drawing;
using System.Reflection;
using System.Windows.Forms;
using System.Xml;
using System.Xml.Linq;
using System.Runtime.InteropServices;

using Rhino.DocObjects;
using Rhino.Collections;
using GH_IO;
using GH_IO.Serialization;
# ---------- c_script: C# ----------
    if(in_run) {
      path = System.IO.Path.GetDirectoryName(in_path) + "\\" + in_name + ".obj";
      int faceCount = 0;
      using(StreamWriter writer = new StreamWriter(path)) {
        for(int n = 0; n < in_mesh.Count; n++) {
          List<String> vert = new List<String>();
          List<String> face = new List<String>();

          in_mesh[n].Faces.ConvertQuadsToTriangles();
          BoundingBox bbox = in_mesh[n].GetBoundingBox(true);

          for(int i = 0; i < in_mesh[n].Vertices.Count; i++) {
            vert.Add(String.Format("v {0} {1} {2}", in_mesh[n].Vertices[i].X, in_mesh[n].Vertices[i].Y, in_mesh[n].Vertices[i].Z));
          }

          for(int i = 0; i < in_mesh[n].TextureCoordinates.Count; i++) {
            double tx = in_mesh[n].TextureCoordinates[i].X;
            double ty = in_mesh[n].TextureCoordinates[i].Y;
            vert.Add(String.Format("vt " + tx.ToString("F6") + " " + ty.ToString("F6")));
          }

          for(int i = 0; i < in_mesh[n].Normals.Count; i++) {
            vert.Add(String.Format("vn {0} {1} {2}", in_mesh[n].Normals[i].X, in_mesh[n].Normals[i].Y, in_mesh[n].Normals[i].Y));
          }

          for(int i = 0; i < in_mesh[n].Faces.Count; i++) {
            MeshFace f = in_mesh[n].Faces.GetFace(i);
            int fa = f.A + 1 + faceCount;
            int fb = f.B + 1 + faceCount;
            int fc = f.C + 1 + faceCount;
            string fas = fa.ToString();
            string fbs = fb.ToString();
            string fcs = fc.ToString();
            face.Add(String.Format("f " + fas + "/" + fas + "/" + fas + " " + fbs + "/" + fbs + "/" + fbs + " " + fcs + "/" + fcs + "/" + fcs));
          }

          for(int i = 0; i < vert.Count; i++) {
            writer.WriteLine(vert[i]);
          }

          writer.WriteLine("");
          writer.WriteLine("g " + in_name + n.ToString());

          for(int i = 0; i < face.Count; i++) {
            writer.WriteLine(face[i]);
          }
          faceCount += in_mesh[n].Vertices.Count;
        }
      }
    }
    A = path;
# ---------- c_script: C# additional code ----------
  String path;
# ---------- end c_script ----------

# ----
panel_4 = Panel(c_script.out)
